# Grasshopper definition ClayVolumneEstimator_v1.gh (Grasshopper 1.0.7)

# ---- group: Control Center
# Rhino File needs to be in MM!
# This script lets you estimate the weight and amount of clay you will need for your print.
# It has some serious estimates in it and should likely be thought of as +/- 20%
# 
# Adjust the Control Center Values to correspond to your system and input your control curves
rough_estimate_of_radius_of_nozzle_size = Slider(6, range=0..10)  # "Rough Estimate of Radius of Nozzle Size or Bead Size ( in MM )"
max_height_of_clay_containing_cylinder = Slider(609, range=0..1000)
circumference_of_your_clay_containing_cy = Slider(93.4, range=0..100)  # "Circumference of your Clay Containing Cylinder"

# ---- group: Inputs
your_toolpath_curve = Curve(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)

# ---- group: Building Clay Visualization
estimate_bead_size = EstimateBeadSize(radius=rough_estimate_of_radius_of_nozzle_size)  # -> pipe_2, line_2
flow = Flow(
    Geometry=estimate_bead_size.pipe_2,
    Base=estimate_bead_size.line_2,
    Target=your_toolpath_curve,
    ReverseBase=False,
    ReverseTarget=False,
    Stretch=True,
    Rigid=False)
volume = Volume(Geometry=flow)  # -> Volume, Centroid

# ---- group: Modeled Build Volumne
division = Division(RadiusOfRealWorldBuildTube=circumference_of_your_clay_containing_cy, B=2)
expression = Expression(v=volume.Volume, r=division, Expression="v/(π*r²)")
cylinder = Cylinder(Base=PlaneXY(0, 0, 0), Radius=division, Length=expression)
cap_holes = CapHoles(Brep=cylinder)

# ---- group: Volume Previewer
custom_preview = CustomPreview(
    Geometry=[cap_holes, flow],
    Material=[ColourSwatch(SwatchColor=RGB(128, 128, 128)), ColourSwatch(SwatchColor=RGB(194, 194, 194))])

# ---- group: Tests
height_of_clay = Panel(expression)
weight_of_clay_in_kg_m3 = Panel("0.0000017")
multiplication = Multiplication(A=volume.Volume, B=weight_of_clay_in_kg_m3)
smaller_than = SmallerThan(FirstNumber=height_of_clay, SecondNumber=max_height_of_clay_containing_cylinder)  # -> SmallerThan, OrEqualTo

# ---- group: Outputs
weight_in_kg = Panel(multiplication)
buildable_with_current_tube_volumne = Panel(smaller_than.SmallerThan)

# ==== cluster EstimateBeadSize
radius = ClusterInput()
unit_y = UnitY(Factor=Slider(178, range=0..500))
line = Line(StartPoint=" 0,0,0", EndPoint=unit_y)
line_2 = ClusterOutput(line)
pipe = Pipe(Curve=line, Radius=radius, Caps=Slider(1, range=0..3))
pipe_2 = ClusterOutput(pipe)
