# Grasshopper definition bm_01.gh (Grasshopper 1.0.7)
# plug-ins: Firefly.Core

ports_available = COMPortsAvailable()
boolean_toggle = BooleanToggle(True)
panel = Panel(ports_available)
open_close_port = OpenClosePort(OpenClosePort=boolean_toggle, PortNumber=ports_available, BaudRate=Slider(115200, range=0..115200))
panel_2 = Panel(open_close_port)

# ---- group: Slight offset + Delay
number_slider = Slider(79, range=79..200)
addition = Addition(A=number_slider, B=Slider(-3, range=-5..20))
num = Number(addition)
num_2 = Number(number_slider)
num_3 = Number(number_slider)
dam = DataDam(DataA=num, BufferDelay=5000000, BufferMode=1)
dam_2 = DataDam(DataA=num_2, BufferDelay=10000000, BufferMode=1)

# ----
number_slider_2 = Slider(137, range=79..200)
num_4 = Number(number_slider_2)
num_5 = Number(number_slider_2)
num_6 = Number(number_slider_2)
dam_3 = DataDam(DataA=num_4, BufferDelay=5000000, BufferMode=2)
dam_4 = DataDam(DataA=num_5, BufferDelay=10000000, BufferMode=2)
num_7 = Number(num_6)
num_8 = Number(num_4)
num_9 = Number(num_5)
uno_write = UnoWrite(
    StartWritingValues=boolean_toggle,
    DigitalPin13=Toggle(False),
    DigitalPin12=0,
    DigitalPin11=0,
    DigitalPin10=0,
    DigitalPin9=num_7,
    DigitalPin8=0,
    DigitalPin6=0,
    DigitalPin5=num_8,
    DigitalPin3=num_9,
    PortNumber=Slider(4, range=0..10))  # -> ArduinoOutput, StatusMessage
panel_3 = Panel(uno_write.ArduinoOutput)
panel_4 = Panel(uno_write.StatusMessage)
